# Grasshopper definition mobius.gh (Grasshopper 0.9.76)
# plug-ins: Biomorpher, MeshEdit Components, LunchBox, Weaverbird

number_slider = Slider(4, range=0..5)
number_slider_2 = Slider(7, range=2..10)
number_slider_3 = Slider(45, range=29..100)
mobius = MobiusSurface(
    UDivisions=100,
    VDivisions=100,
    RParameter=4,
    TParameter=number_slider,
    Scale=5,
    Domain1=Domain(-3.141592654, 3.141592654),
    Domain2=Domain(-1, 1))
genes = GenePool(Decimals=2, Maximum=20, Minimum=0, Value=[6.267536071, 9.705024357])
hex = HexagonCells(Surface=mobius, UDivisions=number_slider_3, VDivisions=number_slider_2, TParameter=0.25)  # -> HexagonCells, Centers
number_slider_4 = Slider(0.2, range=0..10)
wbframe = WeaverbirdsPictureFrame(MeshPolylines=hex.HexagonCells, Distance=5, InsetType=0)
wbthicken = WeaverbirdsMeshThicken(MeshCurves=wbframe, Distance=number_slider_4, OffsetType=0)
area = MeshArea(Mesh=wbthicken)  # -> Area, Centroid
biomorpher = Biomorpher(Sliders=[number_slider_4, number_slider, number_slider_2, number_slider_3], Geometry=wbthicken, Performas=area.Area)
